# Grasshopper definition 1 Pratt.gh (Grasshopper 1.0.7)
# plug-ins: Kangaroo2 Components

# ----
# TRUSS GEOMETRY
number_slider = Slider(2000, range=0..10000)
number_slider_2 = Slider(4, range=0..10)
X = UnitX(Factor=Slider(20000, range=0..100000))
pt = ConstructPoint(XCoordinate=0, YCoordinate=0, ZCoordinate=0)
move = Move(Geometry=pt, Motion=X)  # -> Geometry, Transform
neg = Negative(Value=number_slider)
ln = Line(StartPoint=pt, EndPoint=move.Geometry)
Z = UnitZ(Factor=neg)
divide = DivideCurve(Curve=ln, Count=number_slider_2, Kinks=True)  # -> Points, Tangents, Parameters
lng = ListLength(List=divide.Points)
shift = ShiftList(List=divide.Points, Shift=1, Wrap=False)
subtraction = Subtraction(A=lng, B=1)
short = ShortestList(ListA=shift, ListB=divide.Points, TrimMode=2)  # -> ListA, ListB
division = Division(A=number_slider_2, B=2)
cull_i = CullIndex(List=divide.Points, Indices=flatten([subtraction, Slider(0, range=0..100)]), Wrap=True)
ln_2 = Line(StartPoint=short.ListA, EndPoint=short.ListB)
split = SplitList(List=divide.Points, Index=division)  # -> ListA, ListB
move_2 = Move(Geometry=cull_i, Motion=Z)  # -> Geometry, Transform
short_2 = ShortestList(ListA=split.ListA, ListB=move_2.Geometry, TrimMode=2)  # -> ListA, ListB
ln_3 = Line(StartPoint=cull_i, EndPoint=move_2.Geometry)
division_2 = Division(A=number_slider_2, B=2)
ln_4 = Line(StartPoint=short_2.ListA, EndPoint=short_2.ListB)
shift_2 = ShiftList(List=move_2.Geometry, Shift=1, Wrap=False)
item = ListItem(List=divide.Points, Index=division_2, Wrap=True)
short_3 = ShortestList(ListA=shift_2, ListB=move_2.Geometry, TrimMode=2)  # -> ListA, ListB
yz = YZPlane(Origin=item)
ln_5 = Line(StartPoint=short_3.ListA, EndPoint=short_3.ListB)
mirror = Mirror(Geometry=ln_4, Plane=yz)  # -> Geometry, Transform
truss = Line([ln_2, ln_5, ln_3, ln_4, mirror.Geometry])

# ----
# LOADS
number_slider_3 = Slider(90, range=0..100)
lng_2 = ListLength(List=divide.Points)
load = Slider(100, range=0..100)
subtraction_2 = Subtraction(A=lng_2, B=1)
neg_2 = Negative(Value=number_slider_3)
item_2 = ListItem(List=divide.Points, Index=[Slider(0, range=0..100), subtraction_2], Wrap=True)
Z_2 = UnitZ(Factor=Slider(200, range=0..1000))
expression = Expression(x=neg_2, Expression="x*π/180")
neg_3 = Negative(Value=Slider(200, range=0..1000))
expression_2 = Expression(x=Slider(90, range=0..100), Expression="x*π/180")
move_3 = Move(Geometry=cull_i, Motion=Z_2)  # -> Geometry, Transform
lng_3 = ListLength(List=move_3.Geometry)
expression_3 = Expression(x=load, y=lng_3, Expression="x*y/2")
Z_3 = UnitZ(Factor=neg_3)
symsim = SymbolSimple(Style=15, Size=12, Rotation=expression, Colour=RGB(255, 105, 180))
symsim_2 = SymbolSimple(Style=15, Size=12, Rotation=expression_2, Colour=RGB(255, 105, 180))
move_4 = Move(Geometry=item_2, Motion=Z_3)  # -> Geometry, Transform
tag = TextTag(Location=move_3.Geometry, Text=load)
symbol = SymbolDisplay(Location=move_3.Geometry, Display=symsim)
symbol_2 = SymbolDisplay(Location=move_4.Geometry, Display=symsim_2)
tag_2 = TextTag(Location=move_4.Geometry, Text=expression_3)

division_3 = Division(A=number_slider, B=2)
neg_4 = Negative(Value=division_3)
multiplication = Multiplication(A=number_slider, B=2)
# OUTER RECTANGLE
vec = VectorXYZ(XComponent=neg_4, YComponent=0, ZComponent=number_slider)  # -> Vector, Length
neg_5 = Negative(Value=vec.Vector)
line = LineSDL(Start=move.Geometry, Direction=neg_5, Length=multiplication)
line_2 = LineSDL(Start=pt, Direction=vec.Vector, Length=multiplication)
end = EndPoints(Curve=line)  # -> Start, End
end_2 = EndPoints(Curve=line_2)  # -> Start, End
xz = XZPlane(Origin=Point(0, 0, 0))
rec_2pt = Rectangle2Pt(Plane=xz, PointA=end_2.End, PointB=end.End, Radius=0)  # -> Rectangle, Length

multiplication_2 = Multiplication(A=number_slider, B=2)
xz_2 = XZPlane(Origin=Point(0, 0, 0))
Z_4 = UnitZ(Factor=number_slider)
line_3 = LineSDL(Start=[cull_i, item_2], Direction=Z_4, Length=multiplication_2)
offset = OffsetCurve(Curve=rec_2pt.Rectangle, Distance=Slider(1000, range=0..1000), Plane=xz_2, Corners=1)
srfsplit = SurfaceSplit(Surface=offset, Curves=flatten([truss, line_3, rec_2pt.Rectangle]))
item_3 = ListItem(List=srfsplit, Index=Slider(5, range=0..100), Wrap=True)
item_4 = ListItem(List=srfsplit, Index=Slider(10, range=0..100), Wrap=True)
edges = BrepEdges(Brep=srfsplit)  # -> Naked, Interior, NonManifold
edges_2 = BrepEdges(Brep=item_3)  # -> Naked, Interior, NonManifold
edges_3 = BrepEdges(Brep=item_4)  # -> Naked, Interior, NonManifold
explode = Explode(Curve=edges.Naked, Recursive=True)  # -> Segments, Vertices
end_3 = EndPoints(Curve=edges_3.Naked)  # -> Start, End
end_4 = EndPoints(Curve=edges_2.Naked)  # -> Start, End
srf = Surface(srfsplit)
dupln = RemoveDuplicateLines(Lines=flatten(explode.Segments), Tolerance=0.01)
pdecon = Deconstruct(Point=end_3.Start)  # -> XComponent, YComponent, ZComponent
pdecon_2 = Deconstruct(Point=end_3.End)  # -> XComponent, YComponent, ZComponent
pdecon_3 = Deconstruct(Point=end_4.Start)  # -> XComponent, YComponent, ZComponent
lines_for_region = Line(dupln)
line_of_truss = Line(truss)
pdecon_4 = Deconstruct(Point=end_4.End)  # -> XComponent, YComponent, ZComponent
dupln_2 = RemoveDuplicateLines(Lines=[edges_2.Naked, edges_3.Naked], Tolerance=0.01)
expression_4 = Expression(x=edges_2.Naked, Expression="Format(\"{0}, {1}\", x, y)")

# ---- group: Lower Truss
neg_6 = Negative(Value=Slider(8000, range=0..10000))
Z_5 = UnitZ(Factor=neg_6)
move_5 = Move(Geometry=flatten(truss), Motion=Z_5)  # -> Geometry, Transform

# ----
# FORCE DIAGRAM PRELIM
number_slider_4 = Slider(0, range=0..100)
subtraction_3 = Subtraction(A=number_slider_2, B=1)
dom = ConstructDomain(DomainStart=number_slider_4, DomainEnd=subtraction_3)
range = Range(Domain=dom, Steps=subtraction_3)
expression_5 = Expression(x=load, y=neg_2, z=range, Expression="if(y<0, -x*z, 1*z)")
Z_6 = UnitZ(Factor=expression_5)
pt_2 = ConstructPoint(XCoordinate=Slider(32356, range=0..100000), YCoordinate=0, ZCoordinate=0)
multiplication_3 = Multiplication(A=Z_6, B=10)
move_6 = Move(Geometry=pt_2, Motion=multiplication_3)  # -> Geometry, Transform
lng_4 = ListLength(List=move_6.Geometry)
subtraction_4 = Subtraction(A=lng_4, B=1)
Z_7 = UnitZ(Factor=expression_3)
Z_8 = UnitZ(Factor=expression_3)
multiplication_4 = Multiplication(A=Z_7, B=10)
item_5 = ListItem(List=move_6.Geometry, Index=subtraction_4, Wrap=True)
item_6 = ListItem(List=ln_3, Index=0, Wrap=True)
item_7 = ListItem(List=ln_4, Index=0, Wrap=True)
multiplication_5 = Multiplication(A=Z_8, B=10)
shift_3 = ShiftList(List=move_6.Geometry, Shift=1, Wrap=False)
move_7 = Move(Geometry=item_5, Motion=multiplication_4)  # -> Geometry, Transform
angle = Angle(VectorA=item_6, VectorB=item_7)  # -> Angle, Reflex
short_4 = ShortestList(ListA=shift_3, ListB=move_6.Geometry, TrimMode=2)  # -> ListA, ListB
cos = Cosine(Value=angle.Angle)
sin = Sine(Value=angle.Angle)
move_8 = Move(Geometry=move_7.Geometry, Motion=multiplication_5)  # -> Geometry, Transform
neg_7 = Negative(Value=sin)
ln_6 = Line(StartPoint=short_4.ListA, EndPoint=short_4.ListB)
ln_7 = Line(StartPoint=item_5, EndPoint=move_7.Geometry)
ln_8 = Line(StartPoint=move_7.Geometry, EndPoint=move_8.Geometry)
vec_2 = VectorXYZ(XComponent=neg_7, YComponent=0, ZComponent=cos)  # -> Vector, Length
X_2 = UnitX(Factor=Slider(10000, range=0..10000))
line_4 = LineSDL(Start=move_7.Geometry, Direction=vec_2.Vector, Length=Slider(10000, range=0..10000))
pt_3 = Point([shift_3, move_8.Geometry, move_7.Geometry])
neg_8 = Negative(Value=X_2)
move_9 = Move(Geometry=pt_3, Motion=neg_8)  # -> Geometry, Transform
ln_9 = Line(StartPoint=pt_3, EndPoint=move_9.Geometry)
llx = LineLine(Line1=ln_9, Line2=line_4)  # -> ParamA, ParamB, PointA, PointB
sort_pt = SortPoints(Points=llx.PointA)  # -> Points, Indices
lng_5 = ListLength(List=sort_pt.Points)
division_4 = Division(A=lng_5, B=2)
subtraction_5 = Subtraction(A=division_4, B=1)
split_2 = SplitList(List=sort_pt.Points, Index=subtraction_5)  # -> ListA, ListB
pt_4 = Point(split_2.ListA)
