# Grasshopper definition 2 pratt - Copy.gh (Grasshopper 1.0.7)
# plug-ins: Pufferfish, 3D Graphic Statics V02

# ----
# TRUSS GEOMETRY
number_slider = Slider(2000, range=0..10000)
number_slider_2 = Slider(4, range=0..10)
X = UnitX(Factor=Slider(8000, range=0..100000))
pt = ConstructPoint(XCoordinate=0, YCoordinate=0, ZCoordinate=0)
move = Move(Geometry=pt, Motion=X)  # -> Geometry, Transform
neg = Negative(Value=number_slider)
ln = Line(StartPoint=pt, EndPoint=move.Geometry)
Z = UnitZ(Factor=neg)
divide = DivideCurve(Curve=ln, Count=number_slider_2, Kinks=True)  # -> Points, Tangents, Parameters
lng = ListLength(List=divide.Points)
shift = ShiftList(List=divide.Points, Shift=1, Wrap=False)
subtraction = Subtraction(A=lng, B=1)
short = ShortestList(ListA=shift, ListB=divide.Points, TrimMode=2)  # -> ListA, ListB
division = Division(A=number_slider_2, B=2)
cull_i = CullIndex(List=divide.Points, Indices=flatten([subtraction, Slider(0, range=0..100)]), Wrap=True)
ln_2 = Line(StartPoint=short.ListA, EndPoint=short.ListB)
split = SplitList(List=divide.Points, Index=division)  # -> ListA, ListB
move_2 = Move(Geometry=cull_i, Motion=Z)  # -> Geometry, Transform
short_2 = ShortestList(ListA=split.ListA, ListB=move_2.Geometry, TrimMode=2)  # -> ListA, ListB
ln_3 = Line(StartPoint=cull_i, EndPoint=move_2.Geometry)
division_2 = Division(A=number_slider_2, B=2)
ln_4 = Line(StartPoint=short_2.ListA, EndPoint=short_2.ListB)
shift_2 = ShiftList(List=move_2.Geometry, Shift=1, Wrap=False)
item = ListItem(List=divide.Points, Index=division_2, Wrap=True)
short_3 = ShortestList(ListA=shift_2, ListB=move_2.Geometry, TrimMode=2)  # -> ListA, ListB
yz = YZPlane(Origin=item)
ln_5 = Line(StartPoint=short_3.ListA, EndPoint=short_3.ListB)
mirror = Mirror(Geometry=ln_4, Plane=yz)  # -> Geometry, Transform
truss = Line([ln_2, ln_5, ln_3, ln_4, mirror.Geometry])

# ----
# LOADS
number_slider_3 = Slider(90, range=0..100)
lng_2 = ListLength(List=divide.Points)
load = Slider(100, range=0..100)
subtraction_2 = Subtraction(A=lng_2, B=1)
neg_2 = Negative(Value=number_slider_3)
item_2 = ListItem(List=divide.Points, Index=[Slider(0, range=0..100), subtraction_2], Wrap=True)
Z_2 = UnitZ(Factor=Slider(200, range=0..1000))
expression = Expression(x=neg_2, Expression="x*π/180")
neg_3 = Negative(Value=Slider(200, range=0..1000))
expression_2 = Expression(x=Slider(90, range=0..100), Expression="x*π/180")
move_3 = Move(Geometry=cull_i, Motion=Z_2)  # -> Geometry, Transform
lng_3 = ListLength(List=move_3.Geometry)
expression_3 = Expression(x=load, y=lng_3, Expression="x*y/2")
Z_3 = UnitZ(Factor=neg_3)
symsim = SymbolSimple(Style=15, Size=12, Rotation=expression, Colour=RGB(255, 105, 180))
symsim_2 = SymbolSimple(Style=15, Size=12, Rotation=expression_2, Colour=RGB(255, 105, 180))
move_4 = Move(Geometry=item_2, Motion=Z_3)  # -> Geometry, Transform
tag = TextTag(Location=move_3.Geometry, Text=load)
symbol = SymbolDisplay(Location=move_3.Geometry, Display=symsim)
symbol_2 = SymbolDisplay(Location=move_4.Geometry, Display=symsim_2)
tag_2 = TextTag(Location=move_4.Geometry, Text=expression_3)

# ----
# OUTER RECTANGLE
number_slider_4 = Slider(12, range=0..100)
multiplication = Multiplication(A=number_slider, B=2)
division_3 = Division(A=number_slider, B=2)
multiplication_2 = Multiplication(A=number_slider, B=number_slider_4)
neg_4 = Negative(Value=multiplication_2)
neg_5 = Negative(Value=division_3)
division_4 = Division(A=number_slider, B=2)
vec = VectorXYZ(XComponent=neg_5, YComponent=0, ZComponent=multiplication)  # -> Vector, Length
vec_2 = VectorXYZ(XComponent=division_4, YComponent=0, ZComponent=neg_4)  # -> Vector, Length
move_5 = Move(Geometry=pt, Motion=vec.Vector)  # -> Geometry, Transform
move_6 = Move(Geometry=move.Geometry, Motion=vec_2.Vector)  # -> Geometry, Transform
xz = XZPlane(Origin=Point(0, 0, 0))
rec_2pt = Rectangle2Pt(Plane=xz, PointA=move_5.Geometry, PointB=move_6.Geometry, Radius=0)  # -> Rectangle, Length

multiplication_3 = Multiplication(A=number_slider, B=2)
Z_4 = UnitZ(Factor=number_slider)
line = LineSDL(Start=[cull_i, item_2], Direction=Z_4, Length=multiplication_3)
X_2 = UnitX(Factor=Slider(18920, range=0..100000))
load_2 = Panel("""-1000
-1000
-1000
-1000
-1000
1500
1500""")
node = Panel("""24
23
25
26
27
10
15""")
move_7 = Move(Geometry=pt, Motion=X_2)  # -> Geometry, Transform
srfsplit = SurfaceSplit(Surface=rec_2pt.Rectangle, Curves=flatten([truss, line, rec_2pt.Rectangle]))
load_3 = Panel("""-1000
-1000
-1000
1500
1500""")
node_2 = Panel("""16
15
17
7
10""")
item_3 = ListItem(List=srfsplit, Index=Slider(9, range=0..100), Wrap=False)
edges = BrepEdges(Brep=srfsplit)  # -> Naked, Interior, NonManifold
item_4 = ListItem(List=srfsplit, Index=Slider(2, range=0..100), Wrap=True)
python = GhPythonScript(x=srfsplit)  # -> out, a; inputs x: list
# ---------- python: Python ----------
import rhinoscriptsyntax as rs

i=1
j=7

brep1 = x[i]
brep2 = x[j]
#    if brep2: rs.IntersectBreps( brep1, brep2)
a = rs.IntersectBreps(brep1,brep2)

if a:
    print 2
# ---------- end python ----------
explode = Explode(Curve=edges.Naked, Recursive=True)  # -> Segments, Vertices
brep = Brep(item_4)
brep_2 = Brep(srfsplit)

listdexs = ListIndices(List=srfsplit)
bpt = BrepCentroid(Brep=srfsplit)
tag_3 = TextTag(Location=bpt, Text=listdexs, Colour=RGB(33, 46, 255))

py_get_neighbour_region = GhPythonScript(x=brep_2, y=brep, spanno=number_slider_2, spanload=load)  # -> out, a, b, llist, c, regdline; inputs x: list of Brep, spanno: Int32
# ---------- py_get_neighbour_region: Python ----------
# get the boundary regions of a region
import rhinoscriptsyntax as rs
m=0 
k=0
ls =[]
le=[]
a = []
ll = len(x)
llist = [rs.coercecurve(rs.IntersectBreps(x[0],x[2]))]
regdline = []
llspt = []
for i in range(0,ll):
    a.append([])
    regdline.append([])
    for j in range(0,ll):
        llspt.append([])
        if i !=j :
            brep1 = x[i]
            brep2 = x[j]
            z= rs.IntersectBreps( brep1, brep2 )
            if z:
                a[i].append(j)
                regdline[i].append(z)
                lnew= rs.coercecurve(z)
                m=0
                for k in range(0, len(llist)):
                    if rs.CurveMidPoint(lnew) == rs.CurveMidPoint(llist[k]):
                        m = 1
                if int(m) == 0:
                    llist.append(lnew)

print len(llist)
print a
# ---------- end py_get_neighbour_region ----------
python_2 = GhPythonScript()  # -> out, a; inputs x: list of Brep, z: Int32
# ---------- python_2: Python ----------
import rhinoscriptsyntax as rs


a = []
ll = len(x)
for i in range(0,ll):
    a.append([])
    for j in range(0,ll):
       if i !=j :
            brep1 = x[i]
            brep2 = x[j]
            z= rs.IntersectBreps( brep1, brep2 )
            if z:
                    a[i].append(j)
#            print i ,j
print a
# ---------- end python_2 ----------
item_5 = ListItem(List=explode.Segments, Index=Slider(2, range=0..10), Wrap=True)
line_of_truss = Line(truss)
pt_2 = Point(py_get_neighbour_region.b)
line_2 = Line(py_get_neighbour_region.llist)
cull_i_2 = CullIndex(List=line_2, Indices=flatten(node_2), Wrap=True)

# ---- group: Line Tag
curvepoint = PointOnCurve(line_2, parameter=0.5)
listdexs_2 = ListIndices(List=line_2)
tag_4 = TextTag(Location=curvepoint, Text=listdexs_2, Colour=RGB(176, 176, 176))

# ---- group: Lower Truss
neg_6 = Negative(Value=Slider(8000, range=0..10000))
Z_5 = UnitZ(Factor=neg_6)
move_8 = Move(Geometry=flatten(truss), Motion=Z_5)  # -> Geometry, Transform

# ----
item_6 = ListItem(List=line_2, Index=Slider(3, range=0..25), Wrap=False)

end = EndPoints(Curve=cull_i_2)  # -> Start, End
rempts = RemoveDuplicatePoints(ListOfPoints=[end.End, end.Start], DistanceTolerance=1e-06)  # -> NewListOfPoints, IndicesI, IndicesI_2
truss_vertices = SortPoints(Points=rempts.NewListOfPoints)  # -> Points, Indices
region = Brep(srfsplit)

number_slider_5 = Slider(17, range=0..100)
xz_2 = XZPlane(Origin=truss_vertices.Points)
cir = Circle(Plane=xz_2, Radius=Slider(20, range=0..100))
divide_2 = DivideCurve(Curve=cir, Count=number_slider_5, Kinks=False)  # -> Points, Tangents, Parameters
listdexs_3 = ListIndices(List=divide_2.Points)
tag_5 = TextTag(Location=divide_2.Points, Text=listdexs_3)

# ---- group: Vertices Tag
listdexs_4 = ListIndices(List=truss_vertices.Indices)
tag_6 = TextTag(Location=truss_vertices.Points, Text=listdexs_4, Colour=RGB(176, 176, 176))

# ----
python_3 = GhPythonScript(vertices=truss_vertices.Points, region=region, N=number_slider_5)  # -> out, rav, a; inputs vertices: list, region: list, N: Int32
# ---------- python_3: Python ----------
import rhinoscriptsyntax as rs
import Rhino.Geometry as rg

#creat points for check
regardvtx = []
for i in range(0,len(vertices)):
    regardvtx.append([])
    cv = rs.AddCircle(rs.coerce3dpoint(vertices[i]),200)
    vcpts = rs.DivideCurve(cv,N,True)
    for j in range(0,N-1):
        for k in range(0,len(region)):
            if rs.IsPointOnSurface(region[k], vcpts[j]):
                regardvtx[i].append(k)

print regardvtx
rav = []

# create vertex and region boundary matrix
for i in range(0,len(regardvtx)):
    rav.append([])
    rav[i].append(regardvtx[i][0])
    for j in range(1,len(regardvtx[i])):
        if regardvtx[i][j] != regardvtx[i][j-1]:
            rav[i].append(regardvtx[i][j])
print rav
# ---------- end python_3 ----------

py_solve_gstatics = GhPythonScript(
    x=cull_i_2,
    region=line_2,
    y=flatten(node_2),
    z=flatten(load_3),
    fdsp=move_7.Geometry,
    rav=python_3.rav,
    regd=py_get_neighbour_region.a,
    regdline=py_get_neighbour_region.regdline,
    act_reg=srfsplit,
    all_fd_line=line_2,
    start_reg=Slider(10, range=0..10))  # -> lfm, lfl, pt_fd, cline_all, a; inputs x: list, region: list, y: list, z: list, rav: list, regd: list, regdline: list, act_reg: list, all_fd_line: list
# ---------- py_solve_gstatics: Python ----------
import rhinoscriptsyntax as rs
import Rhino.Geometry as rg
import scriptcontext as sc

#Creates a copy of an array.
def copy_func(original): 
    copy = []
    print original
    for i in range(0,len(original)):
        copy.append(original[i])
    return copy
#load_vec_copy = copy_func(lfl)

#MODULE 1
#list the end and start point of lines as per their indices 
lleng = len(x)  #get length of list
lfm = [[]]      #form diagram line endpoints -2d null matrix
lfs=[]          #form diagram slope lines
#Get End points of the lines in form diagram
for i in range(0, lleng): # LOOP
    lfm.append([])  
    ls = rs.CurveStartPoint(x[i]) #get start point from force diagram
    le = rs.CurveEndPoint(x[i]) # get end point from force diagram
    lsp = rs.coerce3dpoint(ls) #convert guid to point
    lep = rs.coerce3dpoint(rs.AddPoint(le)) #convert guid to point
    lfm[i].append(lsp) #append to list of points
    lfm[i].append(lep) #append to list of points
#get the slope of the line
    if abs(lep[0] - lsp[0]) >= 0.01:
        slope = (lsp[2]-lep[2])/(lsp[0]-lep[0])
        lfs.append(round(slope,2))
    elif abs(lep[0] - lsp[0]) <= 0.01:
        lfs.append(321)
#print lfm
#print lfs

# MODULE 2
#---------------------------------------------------------#
# Add length of each line in force diagram
rlen = len(region)
lfo= [[]]   #force diagram line endpoints -2d null matrix
lfl = []    #length of each lines in force diagram

for i in range(0,rlen):
    chk=0
    for j in range ( 0, len(y)):
        if float(i) == y[j]:
            lfl.append(z[j])
            chk =1
    if chk==0:
        lfl.append(321) 
#print lfl

# MODULE 3
xsp = rs.coerce3dpoint(fdsp)[0]
ysp = rs.coerce3dpoint(fdsp)[1]
zsp = rs.coerce3dpoint(fdsp)[2]

#print "-------------------------module3---------------------------"
curreg=10
tracker= []
tracker.append(curreg)
start_reg = 10
linek = []
#Create a null point co-ordinate for force diagram point coordinate
#Points are currently in y plane. 
pt_fd = [] # force diagram region co-ordinates
def dummy_fd_points():
    for i in range(0,len(regd)):
        pt_fd.append(rg.Point3d(0,1,0)) 
    return pt_fd
dummy_fd_points()
pt_fd[curreg] =rs.coerce3dpoint(fdsp)

#gets the clockwise direction of regions with external loads
def clock(r1,r2):
    for i in range(0,len(rav)):
        for j in range(1,len(rav[i])):
            if rav[i][j-1] == r1:
                if rav[i][j]== r2:
                    print rav[i]
                    return "anti-clock"
        for j in range(1,len(rav[i])):
            if rav[i][j-1] == r2:
                if rav[i][j]== r1:
                    return "clock"
#graphics = clock(0,8)

# returns vector of intersection of regions provided
def vbregion(r1,r2): 
    curl = rs.IntersectBreps(act_reg[r1],act_reg[r2])
    curlvec = rs.VectorCreate(rs.CurveStartPoint(curl),rs.CurveEndPoint(curl))
    return curlvec

# returns line index of intersection of regions provided
def l_index(r1,r2): 
    curl = rs.IntersectBreps(act_reg[r1],act_reg[r2])
    for k in range(0,len(all_fd_line)):
        if rs.CurveMidPoint(curl) == rs.CurveMidPoint(all_fd_line[k]) : 
            line_index = k
    return line_index

# Draw construction line from points to neighbours
def cline(startpoint,curreg):
    curls = [[],[]]
    for i in range(0,len(regd[curreg])):
        r1= curreg
        r2=regd[curreg][i]
        curvec = vbregion(r1,r2)
        curl = rg.Line(rs.coerce3dpoint(startpoint),curvec,10000)
        curls[0].append(curl)
    for i in range(0,len(regd[curreg])):
        r1= curreg
        r2=regd[curreg][i]
        curvec = vbregion(r1,r2)
        curl = rg.Line(rs.coerce3dpoint(startpoint),curvec,10000)
        curls[1].append(l_index(r1,r2))
    return curls
#lines_index = cline(fdsp,10)[1]

#get co-ordinate of lines with known forces
def getcord(r1,r2):
    for i in range(0,1):
        curl_index = l_index(r1,r2)
        curl_vec = vbregion(r1,r2)
        cur_cord = pt_fd[r1]
        curl_mag = lfl[curl_index]
        curl_clock = clock(r1,r2)
        if curl_clock == "clock":
            v_clock = -1
        elif curl_clock =="anti-clock":
            v_clock= 1
        print curl_vec
        if lfl[curl_index] != 321:
            line =rg.Line(cur_cord,curl_vec*v_clock,curl_mag)
            line_guid = sc.doc.Objects.AddLine(line)
        cord = rs.CurveEndPoint(line_guid)
        pt_fd[r2]=cord
        return cord

#create an empty double array
def empty_array2(num,array):
    for i in range(0,num):
        array.append([])
    return array
cline_found = []
cline_all = empty_array2(len(regd),cline_found)

#draw neighbouring points/ construction lines
def region_neighbour(curreg):
    print "draw neighbouring points/ construction lines- current region is" 
    print curreg
    linesf = cline(pt_fd[curreg],curreg)[0]
    cline_all[curreg]=linesf
    neigh_reg = regd[curreg]
    for i in neigh_reg:
        l_cmon = l_index(i,curreg)
        if lfl[l_cmon] != 321:
            neigh_cord = getcord(curreg,i)
            pt_fd[i]=neigh_cord


graphic = region_neighbour(1)

#picks a known region- among neighbour in force diagram
def pick_neighbour(curreg):
    check=0
    neigh=[]
    for i in range(0,len(pt_fd)):
        for j in tracker:
            if j == i:
                check=1
        if pt_fd[i][1] !=1:
            if check!=1:
                neigh.append(i)
    print "neighbour is"
    print neigh
    return neigh
#print pt_fd
print " tracker count"
print tracker
tracker.append(curreg)
m=[0,1,0,1,1,1,0,0,1,0,1,1,0,0,0,1,0]
#call neighbouring regions to draw neighbouring points/ construction lines
def call_neighbour_to_draw(start_reg):
    region_neighbour(10)
    for i in range (0,10):
        curreg= pick_neighbour(start_reg)[m[i]]
        print "---------"
        print curreg
        region_neighbour(curreg)
        print i

call_neighbour_to_draw(start_reg)

print pt_fd
# ---------- end py_solve_gstatics ----------
show_construction_lines = GhPythonScript(x=py_solve_gstatics.cline_all)  # -> out, all_line; inputs x: list
# ---------- show_construction_lines: Python ----------
import rhinoscriptsyntax as rs

#print x
all_line =[]
for i in range(0,len(x)):
    for j in x[i]:
        line = rs.coerceline(j)
        all_line.append(line)
        
print all_line
# ---------- end show_construction_lines ----------
item_7 = ListItem(List=py_solve_gstatics.lfm, Index=Slider(10, range=0..100), Wrap=False)
panel = Panel(py_solve_gstatics.lfm)
python_4 = GhPythonScript(x=item_7)  # -> out, a
# ---------- python_4: Python ----------
import rhinoscriptsyntax as rs
print rs.coerce3dpoint(x[0])
# ---------- end python_4 ----------
python_5 = GhPythonScript(x=python_3.rav)  # -> out, a
# ---------- python_5: Python ----------
import rhinoscriptsyntax as rs
print x
# ---------- end python_5 ----------
panel_2 = Panel(python_3.rav)
