# Grasshopper definition 2 pratt.gh (Grasshopper 1.0.7)
# plug-ins: Pufferfish, Kangaroo2 Components, 3D Graphic Statics V02

# ----
# TRUSS GEOMETRY
number_slider = Slider(2000, range=0..10000)
number_slider_2 = Slider(4, range=0..10)
X = UnitX(Factor=Slider(20000, range=0..100000))
pt = ConstructPoint(XCoordinate=0, YCoordinate=0, ZCoordinate=0)
move = Move(Geometry=pt, Motion=X)  # -> Geometry, Transform
neg = Negative(Value=number_slider)
ln = Line(StartPoint=pt, EndPoint=move.Geometry)
Z = UnitZ(Factor=neg)
divide = DivideCurve(Curve=ln, Count=number_slider_2, Kinks=True)  # -> Points, Tangents, Parameters
lng = ListLength(List=divide.Points)
shift = ShiftList(List=divide.Points, Shift=1, Wrap=False)
subtraction = Subtraction(A=lng, B=1)
short = ShortestList(ListA=shift, ListB=divide.Points, TrimMode=2)  # -> ListA, ListB
division = Division(A=number_slider_2, B=2)
cull_i = CullIndex(List=divide.Points, Indices=flatten([subtraction, Slider(0, range=0..100)]), Wrap=True)
ln_2 = Line(StartPoint=short.ListA, EndPoint=short.ListB)
split = SplitList(List=divide.Points, Index=division)  # -> ListA, ListB
move_2 = Move(Geometry=cull_i, Motion=Z)  # -> Geometry, Transform
short_2 = ShortestList(ListA=split.ListA, ListB=move_2.Geometry, TrimMode=2)  # -> ListA, ListB
ln_3 = Line(StartPoint=cull_i, EndPoint=move_2.Geometry)
division_2 = Division(A=number_slider_2, B=2)
ln_4 = Line(StartPoint=short_2.ListA, EndPoint=short_2.ListB)
shift_2 = ShiftList(List=move_2.Geometry, Shift=1, Wrap=False)
item = ListItem(List=divide.Points, Index=division_2, Wrap=True)
short_3 = ShortestList(ListA=shift_2, ListB=move_2.Geometry, TrimMode=2)  # -> ListA, ListB
yz = YZPlane(Origin=item)
ln_5 = Line(StartPoint=short_3.ListA, EndPoint=short_3.ListB)
mirror = Mirror(Geometry=ln_4, Plane=yz)  # -> Geometry, Transform
truss = Line([ln_2, ln_5, ln_3, ln_4, mirror.Geometry])

# ----
# LOADS
number_slider_3 = Slider(90, range=0..100)
lng_2 = ListLength(List=divide.Points)
load = Slider(100, range=0..100)
subtraction_2 = Subtraction(A=lng_2, B=1)
neg_2 = Negative(Value=number_slider_3)
item_2 = ListItem(List=divide.Points, Index=[Slider(0, range=0..100), subtraction_2], Wrap=True)
Z_2 = UnitZ(Factor=Slider(200, range=0..1000))
expression = Expression(x=neg_2, Expression="x*π/180")
neg_3 = Negative(Value=Slider(200, range=0..1000))
expression_2 = Expression(x=Slider(90, range=0..100), Expression="x*π/180")
move_3 = Move(Geometry=cull_i, Motion=Z_2)  # -> Geometry, Transform
lng_3 = ListLength(List=move_3.Geometry)
expression_3 = Expression(x=load, y=lng_3, Expression="x*y/2")
Z_3 = UnitZ(Factor=neg_3)
symsim = SymbolSimple(Style=15, Size=12, Rotation=expression, Colour=RGB(255, 105, 180))
symsim_2 = SymbolSimple(Style=15, Size=12, Rotation=expression_2, Colour=RGB(255, 105, 180))
move_4 = Move(Geometry=item_2, Motion=Z_3)  # -> Geometry, Transform
tag = TextTag(Location=move_3.Geometry, Text=load)
symbol = SymbolDisplay(Location=move_3.Geometry, Display=symsim)
symbol_2 = SymbolDisplay(Location=move_4.Geometry, Display=symsim_2)
tag_2 = TextTag(Location=move_4.Geometry, Text=expression_3)

# ----
# OUTER RECTANGLE
number_slider_4 = Slider(12, range=0..100)
multiplication = Multiplication(A=number_slider, B=2)
division_3 = Division(A=number_slider, B=2)
multiplication_2 = Multiplication(A=number_slider, B=number_slider_4)
neg_4 = Negative(Value=multiplication_2)
neg_5 = Negative(Value=division_3)
division_4 = Division(A=number_slider, B=2)
vec = VectorXYZ(XComponent=neg_5, YComponent=0, ZComponent=multiplication)  # -> Vector, Length
vec_2 = VectorXYZ(XComponent=division_4, YComponent=0, ZComponent=neg_4)  # -> Vector, Length
move_5 = Move(Geometry=pt, Motion=vec.Vector)  # -> Geometry, Transform
move_6 = Move(Geometry=move.Geometry, Motion=vec_2.Vector)  # -> Geometry, Transform
xz = XZPlane(Origin=Point(0, 0, 0))
rec_2pt = Rectangle2Pt(Plane=xz, PointA=move_5.Geometry, PointB=move_6.Geometry, Radius=0)  # -> Rectangle, Length

multiplication_3 = Multiplication(A=number_slider, B=2)
Z_4 = UnitZ(Factor=number_slider)
line = LineSDL(Start=[cull_i, item_2], Direction=Z_4, Length=multiplication_3)
srfsplit = SurfaceSplit(Surface=rec_2pt.Rectangle, Curves=flatten([truss, line, rec_2pt.Rectangle]))
edges = BrepEdges(Brep=srfsplit)  # -> Naked, Interior, NonManifold
item_3 = ListItem(List=srfsplit, Index=Slider(7, range=0..100), Wrap=False)
item_4 = ListItem(List=srfsplit, Index=Slider(2, range=0..100), Wrap=True)
python = GhPythonScript(x=srfsplit)  # -> out, a; inputs x: list
# ---------- python: Python ----------
import rhinoscriptsyntax as rs

i=1
j=7

brep1 = x[i]
brep2 = x[j]
#    if brep2: rs.IntersectBreps( brep1, brep2)
a = rs.IntersectBreps(brep1,brep2)

if a:
    print 2
# ---------- end python ----------
explode = Explode(Curve=edges.Naked, Recursive=True)  # -> Segments, Vertices
brep = Brep(item_4)
brep_2 = Brep(srfsplit)
listdexs = ListIndices(List=srfsplit)
bpt = BrepCentroid(Brep=srfsplit)
python_2 = GhPythonScript(x=brep_2, y=brep, spanno=number_slider_2, spanload=load)  # -> out, a, b, le, ls, pt, ptl, c, e, d; inputs x: list of Brep, spanno: Int32
# ---------- python_2: Python ----------
import rhinoscriptsyntax as rs

ls =[]
le=[]
a = []
ll = len(x)
llist = []
for i in range(0,ll):
    a.append([])
    for j in range(0,ll):
       if i !=j :
            brep1 = x[i]
            brep2 = x[j]
            z= rs.IntersectBreps( brep1, brep2 )
            if z:

                a[i].append(j)
                lmisc= rs.coercecurve(z)
                print rs.CurveMidPoint(lmisc)
                if i==0:
                    llist.append(lmisc)
                    lleng = len(llist)
                    print lleng
                for k in range(0, lleng):
                    lmid = rs.CurveMidPoint(llist[k])
                    if lmid != rs.CurveMidPoint(lmisc):
                        llist.append(lmisc)
#                                print lmid
                        ls.append(i)
                        le.append(j)

#            print i ,j
print len(llist)
print a 
print ls ,le 


#ptl = []
#lena= len(a)
#print lena
#for i in range(0,lena):
#    print i
#    for j in a[i]:
#        z=rs.IntersectBreps(x[i],x[j])
#        pt = rs.coercecurve(z)
#        ptl.append(pt)
#        print pt
#        print z

#sx = 10000*4 
#b =[]
#for i in range (0, spanno):
#    mypoint= rs.AddPoint((sx,0,100*(0-spanload*i)))
#    b.append(mypoint)

#rxpt = rs.AddPoint((sx,0,100*(0-spanload*i)+100*(spanno-1)*spanload/2))
#b.append(rxpt)
# ---------- end python_2 ----------
python_3 = GhPythonScript()  # -> out, a; inputs x: list of Brep, z: Int32
# ---------- python_3: Python ----------
import rhinoscriptsyntax as rs


a = []
ll = len(x)
for i in range(0,ll):
    a.append([])
    for j in range(0,ll):
       if i !=j :
            brep1 = x[i]
            brep2 = x[j]
            z= rs.IntersectBreps( brep1, brep2 )
            if z:
                    a[i].append(j)
#            print i ,j
print a
# ---------- end python_3 ----------
tag_3 = TextTag(Location=bpt, Text=listdexs, Colour=RGB(33, 46, 255))
item_5 = ListItem(List=explode.Segments, Index=Slider(2, range=0..10), Wrap=True)
line_of_truss = Line(truss)
pt_2 = Point(python_2.b)
item_6 = ListItem(Index=Slider(2, range=0..10), Wrap=True)
explode_2 = Explode(Curve=python_2.a, Recursive=True)  # -> Segments, Vertices
panel = Panel(item_6)
line_2 = Line(explode_2.Segments)

# ---- group: Lower Truss
neg_6 = Negative(Value=Slider(8000, range=0..10000))
Z_5 = UnitZ(Factor=neg_6)
move_7 = Move(Geometry=flatten(truss), Motion=Z_5)  # -> Geometry, Transform

# ----
line_3 = Line(python_2.ptl)
item_7 = ListItem(List=srfsplit, Index=python_2.le, Wrap=False)
item_8 = ListItem(List=srfsplit, Index=python_2.ls, Wrap=True)
dupln = RemoveDuplicateLines(Tolerance=0.01)
