# Grasshopper definition M3 2 15 2021.gh (Grasshopper 1.0.7)

span_no = Slider(10, range=4..20)
truss_height = Slider(3451, range=0..10000)
number_slider = Slider(40000, range=0..100000)
division = Division(TrussSpan=number_slider, B=2)
vec = VectorXYZ(XComponent=division, YComponent=0, ZComponent=truss_height)  # -> Vector, Length
pt = ConstructPoint(XCoordinate=0, YCoordinate=0, ZCoordinate=0)
X = UnitX(Factor=number_slider)
move = Move(Geometry=pt, Motion=vec.Vector)  # -> Geometry, Transform
move_2 = Move(Geometry=pt, Motion=X)  # -> Geometry, Transform
base_line = Line(StartPoint=pt, EndPoint=move_2.Geometry)
number_slider_2 = Slider(2000, range=0..10000)
curve_factor = Slider(0, range=0..10)
divide = DivideCurve(Curve=base_line, SpanNo=span_no, Kinks=False)  # -> Points, Tangents, Parameters

# ---- group: RECTANGLE
division_2 = Division(A=number_slider_2, B=2)
division_3 = Division(A=number_slider_2, B=2)
multiplication = Multiplication(A=division_3, B=10)
vec_2 = VectorXYZ(XComponent=division_2, YComponent=0, ZComponent=division_2)  # -> Vector, Length
vec_3 = VectorXYZ(XComponent=division_3, YComponent=0, ZComponent=multiplication)  # -> Vector, Length
start_point = Point(pt)
neg = Negative(Value=vec_2.Vector)
end_point = Point(move_2.Geometry)
move_3 = Move(Geometry=start_point, Motion=neg)  # -> Geometry, Transform
move_4 = Move(Geometry=end_point, Motion=vec_3.Vector)  # -> Geometry, Transform
xz = XZPlane(Origin=Point(0, 0, 0))
rec_2pt = Rectangle2Pt(Plane=xz, PointA=move_3.Geometry, PointB=move_4.Geometry, Radius=0)  # -> Rectangle, Length

# ----
division_4 = Division(A=number_slider, B=10000)
base_pts_center = CullIndex(List=divide.Points, Indices=[Slider(0, range=0..100), span_no], Wrap=True)
expression = Expression(x=curve_factor, y=division_4, Expression="if(x>y*2,y*2,x)")

# ---- group: REGION LINES
Z = UnitZ(Factor=1)
base_points = Point(divide.Points)
neg_2 = Negative(Value=Z)
line = LineSDL(Start=base_points, Direction=neg_2, Length=number_slider_2)

# ----
pdecon = Deconstruct(Point=base_pts_center)  # -> XComponent, YComponent, ZComponent
truss_height_2 = Number(truss_height)
division_5 = Division(A=expression, B=Slider(100000, range=0..100000))
expression_2 = Expression(depth=truss_height_2, x=pdecon.XComponent, a=division_5, span=number_slider, Expression="depth-a*(span/2-x)²")
vec_4 = VectorXYZ(XComponent=0, YComponent=0, ZComponent=expression_2)  # -> Vector, Length
uppper_pts = Move(Geometry=base_pts_center, Motion=vec_4.Vector)  # -> Geometry, Transform
vertical_chords = Line(StartPoint=base_pts_center, EndPoint=uppper_pts.Geometry)

# ---- group: END LINES
lng = ListLength(List=uppper_pts.Geometry)
subtraction = Subtraction(A=lng, B=1)
item = ListItem(List=uppper_pts.Geometry, Index=Slider(0, range=0..100), Wrap=True)
item_2 = ListItem(List=uppper_pts.Geometry, Index=subtraction, Wrap=True)
line_2 = Line(StartPoint=pt, EndPoint=item)
line_3 = Line(StartPoint=item_2, EndPoint=move_2.Geometry)
endlines = Line([line_2, line_3])

# ---- group: TOP CHORDS
pt_2 = Point(uppper_pts.Geometry)
shift = ShiftList(List=pt_2, Shift=1, Wrap=False)
short = ShortestList(ListA=pt_2, ListB=shift, TrimMode=2)  # -> ListA, ListB
top_chords = Line(StartPoint=short.ListA, EndPoint=short.ListB)

# ---- group: LEFT STRUT LINES
division_6 = Division(SpanNo=span_no, B=2)
bottom_pts_center = Point(base_pts_center)
subtraction_2 = Subtraction(A=division_6, B=1)
split = SplitList(List=bottom_pts_center, Index=subtraction_2)  # -> ListA, ListB
top_pts = Point(uppper_pts.Geometry)
split_2 = SplitList(List=top_pts, Index=subtraction_2)  # -> ListA, ListB
pt_3 = Point(split.ListB)
shift_2 = ShiftList(List=pt_3, Shift=1, Wrap=False)
pt_4 = Point(split_2.ListB)
short_2 = ShortestList(ListA=pt_4, ListB=shift_2, TrimMode=2)  # -> ListA, ListB
ln = Line(StartPoint=short_2.ListA, EndPoint=short_2.ListB)

# ---- group: LEFT STRUTS
division_7 = Division(SpanNo=span_no, B=2)
top_pts_2 = Point(uppper_pts.Geometry)
bottom_pts_center_2 = Point(base_pts_center)
split_3 = SplitList(List=top_pts_2, Index=division_7)  # -> ListA, ListB
split_4 = SplitList(List=bottom_pts_center_2, Index=division_7)  # -> ListA, ListB
pt_5 = Point(split_3.ListA)
pt_6 = Point(split_4.ListA)
shift_3 = ShiftList(List=pt_5, Shift=1, Wrap=False)
short_3 = ShortestList(ListA=shift_3, ListB=pt_6, TrimMode=2)  # -> ListA, ListB
ln_2 = Line(StartPoint=short_3.ListA, EndPoint=short_3.ListB)

# ---- group: PRATT LEFT STRUTS
division_8 = Division(SpanNo=span_no, B=2)
top_pts_3 = Point(uppper_pts.Geometry)
bottom_pts_center_3 = Point(base_pts_center)
split_5 = SplitList(List=top_pts_3, Index=division_8)  # -> ListA, ListB
split_6 = SplitList(List=bottom_pts_center_3, Index=division_8)  # -> ListA, ListB
shift_4 = ShiftList(List=split_6.ListA, Shift=1, Wrap=False)
short_4 = ShortestList(ListA=split_5.ListA, ListB=shift_4, TrimMode=2)  # -> ListA, ListB
ln_3 = Line(StartPoint=short_4.ListA, EndPoint=short_4.ListB)

# ---- group: PRATT RIGHT STRUTS
division_9 = Division(SpanNo=span_no, B=2)
bottom_pts_center_4 = Point(base_pts_center)
subtraction_3 = Subtraction(A=division_9, B=1)
top_pts_4 = Point(uppper_pts.Geometry)
split_7 = SplitList(List=top_pts_4, Index=subtraction_3)  # -> ListA, ListB
split_8 = SplitList(List=bottom_pts_center_4, Index=subtraction_3)  # -> ListA, ListB
shift_5 = ShiftList(List=split_7.ListB, Shift=1, Wrap=False)
short_5 = ShortestList(ListA=shift_5, ListB=split_8.ListB, TrimMode=2)  # -> ListA, ListB
ln_4 = Line(StartPoint=short_5.ListA, EndPoint=short_5.ListB)

# ---- group: WARREN CROSS STRUTS
bottom_pts_center_5 = Point(base_pts_center)
number_slider_3 = Slider(2, range=0..10)
number_slider_4 = Slider(2, range=0..10)
bottom_pts_center_6 = Point(base_pts_center)
shift_6 = ShiftList(List=bottom_pts_center_5, Shift=1, Wrap=False)
top_pts_5 = Point(uppper_pts.Geometry)
shift_7 = ShiftList(List=top_pts_5, Shift=Slider(2, range=0..10), Wrap=False)
top_pts_6 = Point(uppper_pts.Geometry)
shift_8 = ShiftList(List=bottom_pts_center_6, Shift=1, Wrap=False)
culln = CullNth(List=top_pts_6, CullFrequency=number_slider_3)
culln_2 = CullNth(List=shift_6, CullFrequency=number_slider_3)
culln_3 = CullNth(List=shift_7, CullFrequency=number_slider_4)
culln_4 = CullNth(List=shift_8, CullFrequency=number_slider_4)
short_6 = ShortestList(ListA=culln, ListB=culln_2, TrimMode=2)  # -> ListA, ListB
short_7 = ShortestList(ListA=culln_4, ListB=culln_3, TrimMode=2)  # -> ListA, ListB
ln_5 = Line(StartPoint=short_6.ListA, EndPoint=short_6.ListB)
ln_6 = Line(StartPoint=short_7.ListA, EndPoint=short_7.ListB)

# ----
truss_warren = Line([vertical_chords, top_chords, endlines, base_line, ln_5, ln_6])
truss_pratt = Line([vertical_chords, top_chords, endlines, base_line, ln_3, ln_4])
truss_howe = Line([vertical_chords, top_chords, endlines, ln_2, ln, base_line])
truss_selector = Slider(0, range=0..2)
filter = StreamFilter(Gate=truss_selector, Stream0=truss_pratt, Stream1=truss_howe, Stream2=truss_warren)
