# Grasshopper definition Cross.gh (Grasshopper 1.0.7)
# plug-ins: Pufferfish, 3D Graphic Statics V02

number_slider = Slider(3, range=0..3)
division = Division(A=number_slider, B=10000)
number_slider_2 = Slider(309, range=0..1000)
# FROM FIGURE
boundary = Curve(<curve referenced from the Rhino model>)
drawn_truss = Curve([<curve referenced from the Rhino model> x21])
crv = Curve([<curve referenced from the Rhino model> x35])
python = GhPythonScript(x=crv)  # -> out, a; inputs x: list
# ---------- python: Python ----------
import rhinoscriptsyntax as rs
import scriptcontext as sc
import Rhino.Geometry as rg

a=[]
print len(x)
for i in x:
    b = rs.coerceguid(i)
    a.append(b)
#    a= sc.doc.Objects.AddLine(i)
#rs.coercecurve(x)
#a = rs.coerce3dLine(x)
#print len(a)
print a
# ---------- end python ----------
node = Panel("""24
23
25
26
27
6
7""")
load = Panel("""-1000
-1000
-1000
1500
1500""")
line_of_truss = Line(python.a)
X = UnitX(Factor=Slider(20000, range=0..100000))
load_2 = Panel("""-1000
-1000
-1000
-1000
-1000
2500
2500""")
node_2 = Panel("""16
15
17
7
10""")
node_4 = Panel("""12
10
7
4
6
34
13""")
galapagos = Galapagos(fitness=num_2, gene=[depth, number_slider, number_slider_2])

# ----
# TRUSS GEOMETRY
depth = Slider(4612, range=1000..5000)
span = Slider(6, range=0..10)
number_slider_3 = Slider(12000, range=0..100000)
X_2 = UnitX(Factor=number_slider_3)
pt = ConstructPoint(XCoordinate=0, YCoordinate=0, ZCoordinate=0)
move = Move(Geometry=pt, Motion=X_2)  # -> Geometry, Transform
ln = Line(StartPoint=pt, EndPoint=move.Geometry)
divide = DivideCurve(Curve=ln, Count=span, Kinks=True)  # -> Points, Tangents, Parameters
lng = ListLength(List=divide.Points)
shift = ShiftList(List=divide.Points, Shift=1, Wrap=False)
subtraction = Subtraction(A=lng, B=1)
short = ShortestList(ListA=shift, ListB=divide.Points, TrimMode=2)  # -> ListA, ListB
division_2 = Division(A=span, B=2)
cull_i = CullIndex(List=divide.Points, Indices=flatten([subtraction, Slider(0, range=0..100)]), Wrap=True)
ln_2 = Line(StartPoint=short.ListA, EndPoint=short.ListB)
split = SplitList(List=divide.Points, Index=division_2)  # -> ListA, ListB
division_3 = Division(A=span, B=2)
item = ListItem(List=divide.Points, Index=division_3, Wrap=True)
yz = YZPlane(Origin=item)

total_span = Number(span)
subtraction_2 = Subtraction(A=total_span, B=2)
dom = ConstructDomain(DomainStart=Slider(0, range=0..100), DomainEnd=subtraction_2)
range = Range(Domain=dom, Steps=subtraction_2)
division_4 = Division(A=span, B=2)
subtraction_3 = Subtraction(A=division_4, B=1)
expression = Expression(
    a=graft(division),
    depth=depth,
    span=span,
    tspan=number_slider_3,
    i=simplify(graft(range)),
    center=subtraction_3,
    dse=number_slider_2,
    Expression="if(center-i>0,depth-a*(center-i)*(tspan/span)²-dse,depth-a*(-center+i)*(tspan/span)²-dse)")
num = Number(depth)
subtraction_4 = Subtraction(A=num, B=750)
expression_2 = Expression(x=expression, depth=subtraction_4, Expression="if( x > depth,depth, if(x<0,depth,x))")  # -> flatten(R)
panel = Panel(expression)
panel_2 = Panel(expression_2)

neg = Negative(Value=panel_2)
Z = UnitZ(Factor=neg)
move_2 = Move(Geometry=cull_i, Motion=Z)  # -> Geometry, Transform
short_2 = ShortestList(ListA=split.ListA, ListB=move_2.Geometry, TrimMode=2)  # -> ListA, ListB
ln_3 = Line(StartPoint=cull_i, EndPoint=move_2.Geometry)
ln_4 = Line(StartPoint=short_2.ListA, EndPoint=short_2.ListB)
shift_2 = ShiftList(List=move_2.Geometry, Shift=1, Wrap=False)
short_3 = ShortestList(ListA=shift_2, ListB=move_2.Geometry, TrimMode=2)  # -> ListA, ListB
ln_5 = Line(StartPoint=short_3.ListA, EndPoint=short_3.ListB)
mirror = Mirror(Geometry=ln_4, Plane=yz)  # -> Geometry, Transform
truss = Line([ln_2, ln_5, ln_3, ln_4, mirror.Geometry])

# ----
# LOADS
number_slider_4 = Slider(90, range=0..100)
load_3 = Slider(100, range=0..100)
lng_2 = ListLength(List=divide.Points)
subtraction_5 = Subtraction(A=lng_2, B=1)
neg_2 = Negative(Value=number_slider_4)
item_2 = ListItem(List=divide.Points, Index=[Slider(0, range=0..100), subtraction_5], Wrap=True)
Z_2 = UnitZ(Factor=Slider(200, range=0..1000))
expression_3 = Expression(x=neg_2, Expression="x*π/180")
neg_3 = Negative(Value=Slider(200, range=0..1000))
expression_4 = Expression(x=Slider(90, range=0..100), Expression="x*π/180")
move_3 = Move(Geometry=cull_i, Motion=Z_2)  # -> Geometry, Transform
lng_3 = ListLength(List=move_3.Geometry)
expression_5 = Expression(x=load_3, y=lng_3, Expression="x*y/2")
Z_3 = UnitZ(Factor=neg_3)
symsim = SymbolSimple(Style=15, Size=12, Rotation=expression_3, Colour=RGB(255, 105, 180))
symsim_2 = SymbolSimple(Style=15, Size=12, Rotation=expression_4, Colour=RGB(255, 105, 180))
move_4 = Move(Geometry=item_2, Motion=Z_3)  # -> Geometry, Transform
tag = TextTag(Location=move_3.Geometry, Text=load_3)
symbol = SymbolDisplay(Location=move_3.Geometry, Display=symsim)
symbol_2 = SymbolDisplay(Location=move_4.Geometry, Display=symsim_2)
tag_2 = TextTag(Location=move_4.Geometry, Text=expression_5)

multiplication = Multiplication(A=depth, B=2)
Z_4 = UnitZ(Factor=depth)
line = LineSDL(Start=[cull_i, item_2], Direction=Z_4, Length=multiplication)  # disabled
move_5 = Move(Geometry=pt, Motion=X)  # -> Geometry, Transform
srfsplit = SurfaceSplit(Surface=boundary, Curves=flatten([line_of_truss, line, boundary]))
python_2 = GhPythonScript(p4=node_2, p6=node_4, l4=load, l6=load_2, z=span)  # -> point, load; inputs p4: list, p6: list, l4: list, l6: list
# ---------- python_2: Python ----------
import rhinoscriptsyntax as rs

if z== 4:
    point=p4
    load=l4
if z==6:
    point = p6
    load = l6
# ---------- end python_2 ----------

listdexs = ListIndices(List=srfsplit)
bpt = BrepCentroid(Brep=srfsplit)
tag_3 = TextTag(Location=bpt, Text=listdexs, Colour=RGB(33, 46, 255))

brep = Brep(srfsplit)
py_get_neighbour_region = GhPythonScript(start1=Slider(19, range=0..100), start2=Slider(6, range=0..10), x=brep, spanno=span)  # -> a, llist, regdline; inputs start1: Int32, start2: Int32, x: list of Brep, spanno: Int32
# ---------- py_get_neighbour_region: Python ----------
# get the boundary regions of a region
import rhinoscriptsyntax as rs
m=0 
k=0
ls =[]
le=[]
a = []
ll = len(x)
llist = [rs.coercecurve(rs.IntersectBreps(x[start1],x[start2]))]
regdline = []
llspt = []
for i in range(0,ll):
    a.append([])
    regdline.append([])
    for j in range(0,ll):
        llspt.append([])
        if i !=j :
            brep1 = x[i]
            brep2 = x[j]
            z= rs.IntersectBreps( brep1, brep2 )
            if z:
                a[i].append(j)
                regdline[i].append(z)
                lnew= rs.coercecurve(z)
                m=0
                for k in range(0, len(llist)):
                    if rs.CurveMidPoint(lnew) == rs.CurveMidPoint(llist[k]):
                        m = 1
                if int(m) == 0:
                    llist.append(lnew)

print len(llist)
print a
# ---------- end py_get_neighbour_region ----------
line_2 = Line(py_get_neighbour_region.llist)
cull_i_2 = CullIndex(List=line_2, Indices=flatten(python_2.point), Wrap=True)

# ---- group: TRUSS VERTICES
end = EndPoints(Curve=cull_i_2)  # -> Start, End
rempts = RemoveDuplicatePoints(ListOfPoints=[end.End, end.Start], DistanceTolerance=1e-06)  # -> NewListOfPoints, IndicesI, IndicesI_2
truss_vertices = SortPoints(Points=rempts.NewListOfPoints)  # -> Points, Indices
region = Brep(srfsplit)
python_3 = GhPythonScript(vertices=truss_vertices.Points, region=region, N=Slider(17, range=0..100))  # -> out, rav, a; inputs vertices: list, region: list, N: Int32
# ---------- python_3: Python ----------
import rhinoscriptsyntax as rs
import Rhino.Geometry as rg

#creat points for check
regardvtx = []
for i in range(0,len(vertices)):
    regardvtx.append([])
    cv = rs.AddCircle(rs.coerce3dpoint(vertices[i]),200)
    vcpts = rs.DivideCurve(cv,N,True)
    for j in range(0,N-1):
        for k in range(0,len(region)):
            if rs.IsPointOnSurface(region[k], vcpts[j]):
                regardvtx[i].append(k)

#print regardvtx
rav = []

# create vertex and region boundary matrix
for i in range(0,len(regardvtx)):
    rav.append([])
    rav[i].append(regardvtx[i][0])
    for j in range(1,len(regardvtx[i])):
        if regardvtx[i][j] != regardvtx[i][j-1]:
            rav[i].append(regardvtx[i][j])
#print rav
# ---------- end python_3 ----------

# ----
py_solve_gstatics = GhPythonScript(
    x=cull_i_2,
    y=flatten(python_2.point),
    z=flatten(python_2.load),
    fdsp=move_5.Geometry,
    rav=python_3.rav,
    regd=py_get_neighbour_region.a,
    regdline=py_get_neighbour_region.regdline,
    act_reg=srfsplit,
    fd_line=line_2,
    start_reg=Slider(19, range=0..100),
    RUN=Toggle(True))  # -> lfm, lfl, pt_fd, cline_all, graphic; inputs x: list, y: list, z: list, rav: list, regd: list, regdline: list, act_reg: list, fd_line: list, start_reg: Int32
# ---------- py_solve_gstatics: Python ----------
import rhinoscriptsyntax as rs
import Rhino.Geometry as rg
import scriptcontext as sc


#Creates a copy of an array.
def copy_func(original): 
    copy = []
    print original
    for i in range(0,len(original)):
        copy.append(original[i])
    return copy
#load_vec_copy = copy_func(lfl)

#MODULE 1
#list the end and start point of lines as per their indices 
def list_endpoints(a):
    lleng = len(x)  #get length of list
    lfm = [[]]      #form diagram line endpoints -2d null matrix
    lfs=[]          #form diagram slope lines
    #Get End points of the lines in form diagram
    for i in range(0, lleng): # LOOP
        lfm.append([])  
        ls = rs.CurveStartPoint(x[i]) #get start point from force diagram
        le = rs.CurveEndPoint(x[i]) # get end point from force diagram
        lsp = rs.coerce3dpoint(ls) #convert guid to point
        lep = rs.coerce3dpoint(rs.AddPoint(le)) #convert guid to point
        lfm[i].append(lsp) #append to list of points
        lfm[i].append(lep) #append to list of points
        #get the slope of the line
        if abs(lep[0] - lsp[0]) >= 0.01:
            slope = (lsp[2]-lep[2])/(lsp[0]-lep[0])
            lfs.append(round(slope,2))
        elif abs(lep[0] - lsp[0]) <= 0.01:
            lfs.append(321)
#list_endpoints(1)

# MODULE 2
# Add length of each line in force diagram
lfl = []  #length of each lines in force diagram
def force_list(a):
    rlen = len(fd_line)   
    for i in range(0,rlen):
        chk=0
        for j in range (0, len(y)):
            if float(i) == y[j]:
                lfl.append(z[j])
                chk =1
        if chk==0:
            lfl.append(321) 
    return lfl
force_list(1)
#print lfl

#Create List of points(dummy) for corresponding regions in force diagram. #Points are currently in y plane. 
pt_fd = [] # force diagram region co-ordinates.
def dummy_fd_points(a):
    for i in range(0,len(regd)):
        pt_fd.append(rg.Point3d(0,1,0)) 
    pt_fd[start_reg] =rs.coerce3dpoint(fdsp)
    return pt_fd
dummy_fd_points(1)

#Create a tracker for construction line work done.
tracker_cline= [321]
# Create a list for lines in force diagram.
tracker_ptsk = [10]
fdl = []
intersecting_lines =[]
cline_all=[[],[]]

#gets the clockwise direction of regions with external loads
def clock(r1,r2):
    for i in range(0,len(rav)):
        for j in range(1,len(rav[i])):
            if rav[i][j-1] == r1:
                if rav[i][j]== r2:
                    return "anti-clock"
        for j in range(1,len(rav[i])):
            if rav[i][j-1] == r2:
                if rav[i][j]== r1:
                    return "clock"

graphic = clock(2,10)
#print graphic
#print rav

# returns vector of intersection of regions provided
def vbregion(r1,r2): 
    curl = rs.IntersectBreps(act_reg[r1],act_reg[r2])
    curlvec = rs.VectorCreate(rs.CurveStartPoint(curl),rs.CurveEndPoint(curl))
    return curlvec

fdline_data = []
# returns line index of intersection of regions provided
def l_index(r1,r2):
    #print r1
    #print r2
    curl = rs.IntersectBreps(act_reg[r1],act_reg[r2])
    if curl:
        #print " fd line is"
        for k in range(0,len(fd_line)):
            #print rs.CurveMidPoint(curl)
            #print rs.CurveMidPoint(fd_line[k])
            if rs.CurveMidPoint(curl) == rs.CurveMidPoint(fd_line[k]) : 
                line_index = k
                #print "value of k is"
                #print k 
                #print "value of k is"
    return line_index

#print l_index(4,8)



#get co-ordinate of lines with known forces & draw line. 
def getcord(r1,r2):
    for i in range(0,1):
        curl_index = l_index(r1,r2)
        curl_vec = vbregion(r1,r2)
        cur_cord = pt_fd[r1]
        curl_mag = lfl[curl_index]
        curl_clock = clock(r1,r2)
        if curl_clock == "clock":
            v_clock = -1
        elif curl_clock =="anti-clock":
            v_clock= 1                    # print curl_vec
        if lfl[curl_index] != 321:
            line =rg.Line(cur_cord,curl_vec * v_clock,curl_mag)
            line_guid = sc.doc.Objects.AddLine(line)
        cord = rs.CurveEndPoint(line_guid)
        pt_fd[r2]=cord
        #tracker_ptsk.append(r2)
        return cord
#getcord(10,2):

# Draw Cline or Fxdline -with coordinate from a point. 
def lines_and_pt(curreg):
    neigh_reg =regd[curreg]
    for i in neigh_reg:
        l_cmon = l_index(i,curreg)
        if lfl[l_cmon] !=321:
            neigh_cord  = getcord(curreg,i)
            pt_fd[i] = neigh_cord
        elif lfl[l_cmon] == 321:
            r1= curreg
            r2 = i
            if pt_fd[r2][1]==1:
                curvec= vbregion(r1,r2)
                curpt = pt_fd[curreg]
                curl = rg.Line(rs.coerce3dpoint(curpt),curvec,10000)
                cline_all[0].append(curl)
                cline_index = [r1,r2]
                cline_all[1].append(cline_index)
    tracker_cline.append(curreg)
    return cline_all

def knownpts(zz):
    cur_reglist = []
    for i in range(0,len(pt_fd)):
        if pt_fd[i][1] ==0:
            a=1
            if i in tracker_cline:
                a=0
            if a==1:
                cur_reglist.append(i)
    return cur_reglist
#cur_reglist = knownpts(1)

#pick new regions to draw neighbouring or known points/ construction lines

def draw_new_region():
    cur_reglist = knownpts(1) #get known list from list of points
    for j in cur_reglist:
        lines_and_pt(j)
#draw_new_region()

#find list of intersecting regions
def intersecting_clinelist():
    int_index =[]
    in_index =[]
    int_cline =[]
    int_cline_list =[]
    for i in range(0,len(cline_all[0])):
        line1 = cline_all[1][i][0]
        line2 = cline_all[1][i][1]
        for j in range(i+1,len(cline_all[0])):
            if line1==cline_all[1][j][0]:
                index = [line2,cline_all[1][j][1]]
                in_index.append(index)
                int_cline.append([i,j,line1])
            if line1==cline_all[1][j][1]:
                index = [line2,cline_all[1][j][0]]
                in_index.append(index)
                int_cline.append([i,j,line1])
            if line2==cline_all[1][j][0]:
                index = [line1,cline_all[1][j][1]]
                in_index.append(index)
                int_cline.append([i,j,line2])
            if line2==cline_all[1][j][1]:
                index = [line1,cline_all[1][j][0]]
                in_index.append(index)
                int_cline.append([i,j,line2])
    for k in range(0,len(int_cline)):
        if rs.IntersectBreps(act_reg[in_index[k][0]],act_reg[in_index[k][1]]):
            int_index.append(in_index[k])
            int_cline_list.append(int_cline[k])
    return int_cline


#find region point - coordinate by intersection of two cosecutive regions
def pts_intersection(line1,line2,k):
    a=cline_all[0][line1]
    b=cline_all[0][line2]
    pt_intersection = rs.LineLineIntersection(a,b)
    if pt_intersection:
        pt_fd[k]=pt_intersection[0]
    return pt_intersection

#find point and add to list after intersection
def second_type_line():
    for i in range (0,10):
        in_list = intersecting_clinelist()
        for j in in_list:
            #print in_list
            pts_intersect = pts_intersection(j[0],j[1],j[2])
            #in_list = intersecting_clinelist()
            draw_new_region()
    return pts_intersect

if RUN:
    lines_and_pt(start_reg) #get the system started!!!
    second_type_line()


print lfl
#print pt_fd
#print len(pt_fd)

print fdline_data
#def line_endpoints:
#    for i in line
# ---------- end py_solve_gstatics ----------
ga_optimizer = GhPythonScript(fd_line=py_solve_gstatics.pt_fd)  # -> out, a; inputs tr_line: list, fd_line: list
# ---------- ga_optimizer: Python ----------
import rhinoscriptsyntax as rs

print fd_line

for i in fd_line:
    print rs.coerce3dpoint(i)
# ---------- end ga_optimizer ----------
show_construction_lines = GhPythonScript(x=flatten(py_solve_gstatics.cline_all))  # -> out, all_line; inputs x: list
# ---------- show_construction_lines: Python ----------
import rhinoscriptsyntax as rs

#print x
print len(x[0])
all_line =[]
print x
for i in range(0,len(x[0])):
    line = x[0][i]
    all_line.append(line)

print all_line
# ---------- end show_construction_lines ----------

listdexs_2 = ListIndices(List=py_solve_gstatics.pt_fd)
tag_4 = TextTag(Location=py_solve_gstatics.pt_fd, Text=listdexs_2, Colour=RGB(14, 188, 255))

python_4 = GhPythonScript(tr_line=cull_i_2, reg=srfsplit, pt_fd=py_solve_gstatics.pt_fd)  # -> vol, fdl_line; inputs tr_line: list, reg: list, pt_fd: list
# ---------- python_4: Python ----------
import rhinoscriptsyntax as rs

fdl_len = []
fdl_vtx = []
fdl_line=[]

for i in tr_line:
    fdl_len.append(0)
    fdl_vtx.append(0)
    fdl_line.append(0)

#Generate length and vertices of force diagram.
def fdline_vertex() :
    for j in range(0,len(reg)):
        for k in range(0,len(reg)):
            curl = rs.IntersectBreps(reg[j],reg[k])
            if curl:
                for i in range(0,len(tr_line)):
                    if rs.CurveMidPoint(curl) == rs.CurveMidPoint(tr_line[i]):
                        #print j
                        #print k
                        fdl_len[i] = round(rs.Distance(pt_fd[j],pt_fd[k]))
                        fdl_vtx[i]= [j,k] 
                        fdl_line[i]= rs.AddLine(pt_fd[j],pt_fd[k])
    return fdl_len
fdline_vertex()

vol = 0
for i in range(0,len(tr_line)):
    vol = vol + rs.CurveLength(tr_line[0])*fdl_len [i]

vol = vol/10000

print vol 
#print fdl_line
# ---------- end python_4 ----------

# ---- group: Line Tag
curvepoint = PointOnCurve(line_2, parameter=0.518)
listdexs_3 = ListIndices(List=line_2)
tag_5 = TextTag(Location=curvepoint, Text=listdexs_3, Colour=RGB(176, 176, 176))

# ----
line_3 = Line(python_4.fdl_line)
num_2 = Number(python_4.vol)
item_3 = ListItem(List=show_construction_lines.all_line, Index=Slider(0, range=0..100), Wrap=False)
panel_3 = Panel(show_construction_lines.all_line)

# ---- group: TRUSS VERTICES / Vertices Tag
listdexs_4 = ListIndices(List=truss_vertices.Indices)
tag_6 = TextTag(Location=truss_vertices.Points, Text=listdexs_4, Colour=RGB(176, 176, 176))
